# Grasshopper definition Lorenz_Attractor_01.gh (Grasshopper 1.0.7)

panel = Panel("0")
timer = Timer(TimerInterval=1000, Target=c_script)  # disabled
timer_2 = Timer(TimerInterval=20, Target=c_script_2)  # disabled
division = Division(A=Slider(8, range=0..10), B=Slider(3, range=0..10))
division_2 = Division(A=Slider(8, range=0..10), B=Slider(3, range=0..10))
c_script = CSharpScript(count=Slider(5, range=0..6000), rho=Slider(28, range=0..100), sigma=Slider(10, range=0..10), beta=division)  # -> out, A; inputs count: Int32, rho: Double, sigma: Double, beta: Double
# ---------- c_script: C# ----------
    // reference : https://www.algosome.com/articles/lorenz-attractor-programming-code.html

    double t = 0.01;

    pts.Clear();
    pts.Add(state);

    for (int i = start; i < stop; i++){

      double xt = state.X + t * sigma * (state.Y - state.X);
      double yt = state.Y + t * (state.X * (rho - state.Z) - state.Y);
      double zt = state.Z + t * (state.X * state.Y - beta * state.Z);
      state = new Point3d(xt, yt, zt);
      pts.Add(state);

    }

    Print(string.Format("Start: {0} | Stop: {1}", start.ToString(), stop.ToString()));

    start += 1;
    stop += 1;
    
    A = pts;
# ---------- c_script: C# additional code ----------
  Point3d state = new Point3d(0.1, 0, 0);
  List<Point3d> pts = new List<Point3d>();
  int start = 0;
  int stop = 25;
# ---------- end c_script ----------
c_script_2 = CSharpScript(count=Slider(5, range=0..6000), rho=Slider(28, range=0..100), sigma=Slider(10, range=0..10), beta=division_2)  # -> out, A; inputs count: Int32, rho: Double, sigma: Double, beta: Double
# ---------- c_script_2: C# ----------
    // reference : https://www.algosome.com/articles/lorenz-attractor-programming-code.html
    stop += 5;

    List<Point3d> pts = new List<Point3d>();

    double t = 0.01;

    Point3d state = new Point3d(0.1, 0, 0);
    pts.Add(state);

    for (int i = 0; i < stop; i++){

      double xt = state.X + t * sigma * (state.Y - state.X);
      double yt = state.Y + t * (state.X * (rho - state.Z) - state.Y);
      double zt = state.Z + t * (state.X * state.Y - beta * state.Z);
      state = new Point3d(xt, yt, zt);
      pts.Add(state);

    }


    A = pts;
# ---------- c_script_2: C# additional code ----------
  int start ;
  int stop ;
# ---------- end c_script_2 ----------
list_length = ListLength(List=c_script.A)
list_length_2 = ListLength(List=c_script_2.A)
interpolate = Interpolate(Vertices=c_script_2.A, Degree=3, Periodic=False, KnotStyle=1)  # -> Curve, Length, Domain
interpolate_2 = Interpolate(Vertices=c_script.A, Degree=3, Periodic=False, KnotStyle=1)  # -> Curve, Length, Domain
panel_2 = Panel(c_script.out)
panel_3 = Panel(interpolate_2.Curve)
panel_4 = Panel(list_length)
panel_5 = Panel(list_length_2)
panel_6 = Panel(interpolate.Curve)
perp_frame = PerpFrame(Curve=reparameterize(interpolate.Curve), Parameter=0)
polygon = Polygon(Plane=perp_frame, Radius=Slider(0.5, range=0..3), Segments=3, FilletRadius=0)  # -> Polygon, Length
extrude_along = ExtrudeAlong(Base=polygon.Polygon, Curve=interpolate.Curve)
custom_preview = CustomPreview(Geometry=extrude_along, Material=ColourSwatch(SwatchColor=RGB(0, 0, 255)))
