# Grasshopper definition Persistent_Variables_01.gh (Grasshopper 1.0.7)

number_slider = Slider(4, range=0..4)
timer = Timer(Interval=100, TimerInterval=100, Target=c_script)  # disabled
c_script = CSharpScript(reset=Button(), limitPolyline=Toggle(True))  # -> out, A, B; inputs reset: Boolean, limitPolyline: Boolean
# ---------- c_script: C# ----------
    if(reset){
      pt = new Point3d(0, 0, 0);
      pts = new List<Point3d>();
    }
    else{
      double x = random.NextDouble() - 0.5;
      double y = random.NextDouble() - 0.5;
      pt += new Vector3d(x, y, 0);

      pts.Add(pt);

      if(limitPolyline && pts.Count > 10)
        pts.RemoveAt(0);

      pln = new Polyline(pts);
    }




    A = pts;
    B = pln;
# ---------- c_script: C# additional code ----------
  Point3d pt = new Point3d(0, 0, 0);
  Random random = new Random();
  List<Point3d> pts = new List<Point3d>();
  Polyline pln = new Polyline();
# ---------- end c_script ----------
c_script_2 = CSharpScript(num=Slider(200, range=10..200))  # -> out, A; inputs num: Int32
# ---------- c_script_2: C# ----------
    Random rand = new Random();
    List<Point3d> pts = new List<Point3d>();

    for(int i = 0; i < num; i++){

      double x = rand.NextDouble() * 6.0 - 3.0;
      double y = rand.NextDouble() * 6.0 - 3.0;
      Point3d pt = new Point3d(x, y, 0);
      pts.Add(pt);

    }

    A = pts;
# ---------- end c_script_2 ----------
c_script_3 = CSharpScript(num=Slider(33, range=10..200), radius=number_slider, iterationCount=Slider(46, range=0..200), reset=Button())  # -> out, A; inputs num: Int32, radius: Double, iterationCount: Int32, reset: Boolean
# ---------- c_script_3: C# ----------
    if(reset || cents.Count == 0 ){
      cents = StartingPos(num);
    } else{

      //cents = StartingPos(num);
      Print("Cents: " + cents.Count.ToString());
      Print("Num: " + num.ToString());

      for(int i = 0; i < iterationCount; i++){

        List<Vector3d> totalMoves = new List<Vector3d>();
        List<int> collisionCount = new List<int>();

        for(int j = 0; j < cents.Count; j++){               // create empty list of vectors
          totalMoves.Add(new Vector3d(0, 0, 0));
          collisionCount.Add(0);
        }

        for(int j = 0; j < cents.Count; j++){
          for(int k = j + 1; k < cents.Count; k++){
            double d = cents[j].DistanceTo(cents[k]);       // calc dists
            // Print("Iteration: " + i.ToString() + " Dists: " + d.ToString());

            if(d > radius * 2) continue;

            Vector3d move = cents[j] - cents[k];            // calc vect between pts
            move.Unitize();                                 // unitize
            move *= 0.5 * ((radius * 2) - d);                     // split vector in half and multiply by overlap distance

            totalMoves[j] += move;
            totalMoves[k] -= move;
            collisionCount[j]++;
            collisionCount[k]++;

          }
        }

        for(int j = 0; j < cents.Count; j++){
          if(collisionCount[j] > 0){
            Vector3d average = totalMoves[j] / collisionCount[j];
            Print("Average: " + average.ToString());
            cents[j] += average;
          }
        }
      }
    }

    A = cents;
# ---------- c_script_3: C# additional code ----------
  List<Point3d> cents = new List<Point3d>();
  Random rand = new Random();

  public List<Point3d> StartingPos(int numPts){

    List<Point3d> pts = new List<Point3d>();

    for(int i = 0; i < numPts; i++){

      double x = rand.NextDouble() * 6.0 - 3.0;
      double y = rand.NextDouble() * 6.0 - 3.0;
      Point3d pt = new Point3d(x, y, 0);
      pts.Add(pt);
      //Print(pt.ToString());

    }
    return pts;
  }
# ---------- end c_script_3 ----------
c_script_4 = CSharpScript(num=Slider(116, range=10..200), iterationCount=Slider(40, range=0..200), reset=Button())  # -> out, A; inputs num: Int32, iterationCount: Int32, reset: Boolean
# ---------- c_script_4: C# ----------
    if(reset || cents.Count == 0 ){
      cents = StartingPos(num);
      radii = StartingRadii(num);
    } else{

      //cents = StartingPos(num);
      Print("Cents: " + cents.Count.ToString());
      Print("Num: " + num.ToString());

      for(int i = 0; i < iterationCount; i++){

        List<Vector3d> totalMoves = new List<Vector3d>();
        List<int> collisionCount = new List<int>();

        for(int j = 0; j < cents.Count; j++){               // create empty list of vectors
          totalMoves.Add(new Vector3d(0, 0, 0));
          collisionCount.Add(0);
        }

        for(int j = 0; j < cents.Count; j++){
          for(int k = j + 1; k < cents.Count; k++){
            double d = cents[j].DistanceTo(cents[k]);       // calc dists
            // Print("Iteration: " + i.ToString() + " Dists: " + d.ToString());

            if(d > radii[j] + radii[k]) continue;

            Vector3d move = cents[j] - cents[k];            // calc vect between pts
            move.Unitize();                                 // unitize
            move *= 0.5 * ((radii[j] + radii[k]) - d);                     // split vector in half and multiply by overlap distance

            totalMoves[j] += move;
            totalMoves[k] -= move;
            collisionCount[j]++;
            collisionCount[k]++;

          }
        }

        for(int j = 0; j < cents.Count; j++){
          if(collisionCount[j] > 0){
            Vector3d average = totalMoves[j] / collisionCount[j];
            Print("Average: " + average.ToString());
            cents[j] += average;
            crvs[j] = new Circle(cents[j], radii[j]).ToNurbsCurve();
          }
        }
      }
    }

    A = crvs;
# ---------- c_script_4: C# additional code ----------
  List<Point3d> cents = new List<Point3d>();
  List<Curve> crvs = new List<Curve>();
  List<double> radii = new List<double>();
  Random rand = new Random();

  // create a random set of starting position
  public List<Point3d> StartingPos(int numPts){

    List<Point3d> pts = new List<Point3d>();

    for(int i = 0; i < numPts; i++){
      double x = rand.NextDouble() * 6.0 - 3.0;
      double y = rand.NextDouble() * 6.0 - 3.0;
      Point3d pt = new Point3d(x, y, 0);
      pts.Add(pt);
      //Print(pt.ToString());
    }
    return pts;
  }

  
  // create random set of radii
  public List<double> StartingRadii(int numPts){
    List<double> rads = new List<double>();
    crvs.Clear();

    for(int i = 0; i < numPts; i++){
      rads.Add(rand.NextDouble() * 5);

      if(i < cents.Count && i < radii.Count){
        crvs.Add(new Circle(cents[i], radii[i]).ToNurbsCurve());
      }else{
        Print("Rad Count: " + rads.Count.ToString() + " I: " + i.ToString());
      }
    }
    return rads;
  }
# ---------- end c_script_4 ----------
panel = Panel(c_script_2.out)
panel_2 = Panel(c_script.out)
panel_3 = Panel(c_script_3.out)
panel_4 = Panel(c_script_4.out)
panel_5 = Panel(c_script_4.A)
circle = Circle(Plane=c_script_3.A, Radius=number_slider)
panel_6 = Panel(c_script_3.A)
