# Grasshopper definition Persistent_Variables_01.gh (Grasshopper 1.0.7)

timer = Timer(TimerInterval=100, Target=c_script)  # disabled
c_script = CSharpScript(reset=Button(), limitPolyline=Toggle(True))  # -> out, A, B; inputs reset: Boolean, limitPolyline: Boolean
# ---------- c_script: C# ----------
    if(reset){
      pt = new Point3d(0, 0, 0);
      pts = new List<Point3d>();
    }
    else{
      double x = random.NextDouble() - 0.5;
      double y = random.NextDouble() - 0.5;
      pt += new Vector3d(x, y, 0);

      pts.Add(pt);

      if(limitPolyline && pts.Count > 10)
        pts.RemoveAt(0);

      pln = new Polyline(pts);
    }




    A = pts;
    B = pln;
# ---------- c_script: C# additional code ----------
  Point3d pt = new Point3d(0, 0, 0);
  Random random = new Random();
  List<Point3d> pts = new List<Point3d>();
  Polyline pln = new Polyline();
# ---------- end c_script ----------
c_script_2 = CSharpScript(num=Slider(200, range=10..200))  # -> out, A; inputs num: Int32
# ---------- c_script_2: C# ----------
    Random rand = new Random();
    List<Point3d> pts = new List<Point3d>();

    for(int i = 0; i < num; i++){

      double x = rand.NextDouble() * 6.0 - 3.0;
      double y = rand.NextDouble() * 6.0 - 3.0;
      Point3d pt = new Point3d(x, y, 0);
      pts.Add(pt);

    }

    A = pts;
# ---------- end c_script_2 ----------
panel = Panel(c_script_2.out)
panel_2 = Panel(c_script.out)
