# Grasshopper definition Worley_Noise_01.gh (Grasshopper 1.0.7)
# plug-ins: Weaverbird

number_slider = Slider(2, range=0..10)
number_slider_2 = Slider(10, range=0..100)
number_slider_3 = Slider(10, range=0..100)
number_slider_4 = Slider(10, range=0..100)
construct_point = ConstructPoint(XCoordinate=0, YCoordinate=0, ZCoordinate=0)
rectangle = Rectangle(Plane=PlaneXY(0, 0, 0), XSize=number_slider, YSize=number_slider, Radius=0)  # -> Rectangle, Length
series = Series(Start=0, Step=number_slider, Count=number_slider_4)
multiplication = Multiplication(A=number_slider, B=number_slider_2)
multiplication_2 = Multiplication(A=number_slider, B=number_slider_3)
multiplication_3 = Multiplication(A=number_slider, B=number_slider_4)
rectangular_array = RectangularArray(Geometry=construct_point, Cell=rectangle.Rectangle, XCount=number_slider_2, YCount=number_slider_3)  # -> Geometry, Transform
unit_z = UnitZ(Factor=series)  # -> graft(UnitVector)
c_script = CSharpScript(x=multiplication, y=multiplication_2, z=multiplication_3, num=Slider(6, range=0..50))  # -> out, A; inputs x: Int32, y: Int32, z: Int32, num: Int32
# ---------- c_script: C# ----------
    List<Point3d> pts = new List<Point3d>();
    Random rand = new Random();

    for(int i = 0; i < num; i++){
      double x1 = rand.Next(x );
      double y1 = rand.Next(y );
      double z1 = rand.Next(z );
      pts.Add(new Point3d(x1, y1, z1));
    }

    A = pts;
# ---------- end c_script ----------
sphere = Sphere(Base=c_script.A, Radius=1)
move = Move(Geometry=rectangular_array.Geometry, Motion=unit_z)  # -> simplify(Geometry), Transform
panel = Panel(c_script.A)
param_viewer = ParamViewer(move.Geometry)
c_script_2 = CSharpScript(x=move.Geometry, y=c_script.A)  # -> out, A; inputs x: tree of Point3d, y: list of Point3d
# ---------- c_script_2: C# usings ----------
using System.Drawing;
# ---------- c_script_2: C# ----------
    DataTree<GH_Colour> cols = new DataTree<GH_Colour>();
    DataTree<double> di = new DataTree<double>();

    for(int i = 0; i < x.BranchCount; i++){
      GH_Path pa = new GH_Path(i);

      for(int j = 0; j < x.Branch(i).Count; j++){

        List<double> dists = new List<double>();
        for(int k = 0; k < y.Count; k++){
          double dist = x.Branch(i)[j].DistanceTo(y[k]);
          dists.Add(dist);
        }
        dists.Sort();

        //Color cl = Color.FromArgb(i, j, 0);
        //Color cl = Color.FromArgb((int)dists[0]);
        //GH_Colour col = new GH_Colour(cl);

        //cols.Add(col, pa);
        di.Add(dists[0], pa);

      }
    }

    A = di;
# ---------- end c_script_2 ----------
flatten_tree = FlattenTree(Tree=c_script_2.A, Path="{0}")
param_viewer_2 = ParamViewer(c_script_2.A)
sort_list = SortList(Keys=flatten_tree)  # -> Keys, ValuesValuesA
list_item = ListItem(List=sort_list.Keys, Index=0, Wrap=True)  # -> Item1, Item
number_slider_5 = Slider(7.9, range=0..20)
panel_2 = Panel(list_item.Item1)
construct_domain = ConstructDomain(DomainStart=0, DomainEnd=list_item.Item1)
construct_domain_2 = ConstructDomain(DomainStart=0, DomainEnd="255")
center_box = CenterBox(Base=move.Geometry, X=1, Y=1, Z=1)
deconstruct_brep = DeconstructBrep(Brep=center_box)  # -> Faces, Edges, Vertices; disabled
scale = Scale(Geometry=center_box, Center=move.Geometry, Factor=Slider(0.889, range=0..1))  # -> Geometry, Transform
remap_numbers = RemapNumbers(Value=c_script_2.A, Source=construct_domain, Target=construct_domain_2)  # -> Mapped, Clipped
flatten_tree_2 = FlattenTree(Tree=deconstruct_brep.Faces, Path="{0}")
panel_3 = Panel("2")
area = Area(Geometry=flatten_tree_2)  # -> Area, Centroid
gradient = Gradient(
    LowerLimit="0",
    UpperLimit="255",
    Parameter=remap_numbers.Mapped,
    stops=[0.15: RGB(222, 255, 130), 0.85: RGB(0, 161, 219)])
panel_4 = Panel(remap_numbers.Mapped)
cull_duplicates = CullDuplicates(Points=area.Centroid, Tolerance=0.1, CullMode=1)  # -> Points, Indices, Valence
c_script_3 = CSharpScript(num=remap_numbers.Mapped, threshold=Slider(113.276, range=0..255), factor=Slider(5, range=0.1..5))  # -> out, A; inputs num: tree of Double, threshold: Double, factor: Double
# ---------- c_script_3: C# ----------
    for(int i = 0; i < num.BranchCount; i++){
      for(int j = 0; j < num.Branch(i).Count; j++){
        if (num.Branch(i)[j] < threshold) num.Branch(i)[j] = num.Branch(i)[j] / factor;
      }
    }
    A = num;
# ---------- end c_script_3 ----------
split_argb = SplitARGB(Colour=gradient, IntegerChannels=True)  # -> Alpha, Red, Green, Blue
cull_index = CullIndex(List=flatten_tree_2, Indices=cull_duplicates.Indices, Wrap=True)
panel_5 = Panel(c_script_3.A)
deconstruct_brep_2 = DeconstructBrep(Brep=cull_index)  # -> Faces, Edges, Vertices
colour_rgb = ColourRGB(Alpha=c_script_3.A, Red=split_argb.Red, Green=split_argb.Green, Blue=split_argb.Blue)
button = Button()
join_curves = JoinCurves(Curves=deconstruct_brep_2.Edges, Preserve=False)  # -> simplify(Curves)
custom_preview = CustomPreview(Geometry=center_box, Material=colour_rgb)
polygon_center = PolygonCenter(Polyline=join_curves)  # -> CenterV, CenterE, CenterA
panel_7 = Panel(join_curves)
larger_than = LargerThan(FirstNumber=c_script_3.A, SecondNumber=Slider(150, range=0..1000))  # -> LargerThan, OrEqualTo
c_script_4 = CSharpScript(x=polygon_center.CenterV, y=c_script.A)  # -> out, A; inputs x: tree of Point3d, y: list of Point3d; same code as c_script_2
flatten_tree_3 = FlattenTree(Tree=c_script_4.A, Path="{0}")
cull_pattern = CullPattern(List=center_box, CullPattern=larger_than.LargerThan)
sort_list_2 = SortList(Keys=flatten_tree_3)  # -> Keys, ValuesValuesA
flatten_tree_4 = FlattenTree(Tree=cull_pattern, Path="{0}")
list_item_2 = ListItem(List=sort_list_2.Keys, Index=0, Wrap=True)  # -> Item1, Item
mesh = Mesh(flatten_tree_4)
mesh_join = MeshJoin(Meshes=mesh)
construct_domain_3 = ConstructDomain(DomainStart=0, DomainEnd=list_item_2.Item1)
construct_domain_4 = ConstructDomain(DomainStart=Slider(0.001, range=0..1), DomainEnd=Slider(0.99, range=0..1))
panel_8 = Panel(mesh_join)
weaverbird_s_catmull_clark_subdivision = WeaverbirdsCatmullClarkSubdivision(MeshCurves=mesh_join, Level=Slider(2, range=0..3), SmoothNakedEdges=Slider(0, range=0..2))
remap_numbers_2 = RemapNumbers(Value=c_script_4.A, Source=construct_domain_3, Target=construct_domain_4)  # -> Mapped, Clipped
param_viewer_3 = ParamViewer(remap_numbers_2.Mapped)
weaverbird_s_picture_frame = WeaverbirdsPictureFrame(MeshPolylines=join_curves, Distance=remap_numbers_2.Mapped, InsetType=1)  # -> simplify(flatten(OutMesh))
weaverbird_s_mesh_thicken = WeaverbirdsMeshThicken(MeshCurves=weaverbird_s_picture_frame, Distance=Slider(0.25, range=0..1), OffsetType=1)  # -> flatten(OutputMeshCurves)
mesh_join_2 = MeshJoin(Meshes=weaverbird_s_mesh_thicken)
deconstruct_mesh = DeconstructMesh(Mesh=mesh_join_2)  # -> Vertices, Faces, Colours, Normals
param_viewer_4 = ParamViewer(mesh_join_2)
graft_tree = GraftTree(Tree=deconstruct_mesh.Vertices, IncludeEmptyLists=True, IncludeNullItems=True)
c_script_5 = CSharpScript(x=graft_tree, y=c_script.A)  # -> out, A; inputs x: tree of Point3d, y: list of Point3d; same code as c_script_2
flatten_tree_5 = FlattenTree(Tree=c_script_5.A, Path="{0}")
sort_list_3 = SortList(Keys=flatten_tree_5)  # -> Keys, ValuesValuesA
list_item_3 = ListItem(List=sort_list_3.Keys, Index=0, Wrap=True)  # -> Item1, Item
gradient_2 = Gradient(
    LowerLimit="0",
    UpperLimit=list_item_3.Item1,
    Parameter=flatten_tree_5,
    stops=[0.15: RGB(222, 255, 130), 0.85: RGB(0, 161, 219)])
param_viewer_5 = ParamViewer(gradient_2)
split_argb_2 = SplitARGB(Colour=gradient_2, IntegerChannels=True)  # -> Alpha, Red, Green, Blue
colour_rgb_2 = ColourRGB(Alpha=255, Red=split_argb_2.Red, Green=split_argb_2.Green, Blue=split_argb_2.Blue)
construct_mesh = ConstructMesh(Vertices=deconstruct_mesh.Vertices, Faces=deconstruct_mesh.Faces, Colours=colour_rgb_2)
weaverbird_s_catmull_clark_subdivision_2 = WeaverbirdsCatmullClarkSubdivision(MeshCurves=construct_mesh, Level=Slider(2, range=0..3), SmoothNakedEdges=2)
