# Grasshopper definition Room_Data_01.gh (Grasshopper 1.0.7)
# plug-ins: Konstru

max_pt = Panel("""4.66666666666667
7.16666666666668
0""")
min_pt = Panel("""-4.66666666666667
-7.16666666666668
0""")
levels = Panel("""0
10""")
max_pt_2 = Panel("""-0.161300525575361
-1.63108976609036
5""")
min_pt_2 = Panel("""-9.49463385890869
-15.9644230994237
0""")
panel = Panel("""-0.161300525575361
-15.9644230994237
4""")
panel_2 = Panel("""-0.161300525575361
-1.63108976609039
4""")
panel_3 = Panel("""-9.494633859
-15.964423099
4.000000000""")
panel_4 = Panel("""-0.161300526
-15.964423099
4.000000000""")
panel_5 = Panel("""-9.494633859
-1.631089766
4.000000000""")
panel_6 = Panel("""-9.494633859
-15.964423099
4.000000000""")
panel_7 = Panel("""-0.161300526
-1.631089766
4.000000000""")
panel_8 = Panel("""-9.494633859
-1.631089766
4.000000000""")
panel_9 = Panel("""-0.161300526
-3.464995135
5.000000000""")
panel_10 = Panel("""-9.494633859
-12.798328469
5.000000000""")
panel_11 = Panel("""-0.161300526
-13.311363170
5.000000000""")
panel_12 = Panel("""-9.494633859
-3.978029836
5.000000000""")
panel_13 = Panel("minPt = {(45.005366141, -16.631089766, 0.000000000)}")
panel_14 = Panel("maxPt = {(60.005366141, -1.631089766, 30.000000000)}")

panel_15 = Panel("""Startpoint (45.005366141, -1.631089766, 30.000000000) Endpoint (45.005366141, -16.631089766, 30.000000000)
Startpoint (45.005366141, -16.631089766, 30.000000000) Endpoint (53.172032808, -16.631089766, 30.000000000)
Startpoint (53.172032808, -16.631089766, 30.000000000) Endpoint (53.172032808, -1.631089766, 30.000000000)
Startpoint (53.172032808, -1.631089766, 30.000000000) Endpoint (45.005366141, -1.631089766, 30.000000000)
Startpoint (45.005366141, -16.631089766, 0.000000000) Endpoint (45.005366141, -1.631089766, 0.000000000)
Startpoint (45.005366141, -1.631089766, 0.000000000) Endpoint (60.005366141, -1.631089766, 0.000000000)
Startpoint (60.005366141, -1.631089766, 0.000000000) Endpoint (60.005366141, -16.631089766, 0.000000000)
Startpoint (60.005366141, -16.631089766, 0.000000000) Endpoint (45.005366141, -16.631089766, 0.000000000)
Startpoint (45.005366141, -1.631089766, 30.000000000) Endpoint (45.005366141, -1.631089766, 0.000000000)
Startpoint (60.005366141, -16.631089766, 10.500000000) Endpoint (53.172032808, -16.631089766, 10.500000000)
Startpoint (53.172032808, -16.631089766, 10.500000000) Endpoint (53.172032808, -16.631089766, 30.000000000)
Startpoint (45.005366141, -16.631089766, 0.000000000) Endpoint (45.005366141, -16.631089766, 30.000000000)
Startpoint (60.005366141, -1.631089766, 10.500000000) Endpoint (60.005366141, -16.631089766, 10.500000000)
Startpoint (60.005366141, -16.631089766, 0.000000000) Endpoint (60.005366141, -16.631089766, 10.500000000)
Startpoint (53.172032808, -1.631089766, 30.000000000) Endpoint (53.172032808, -1.631089766, 10.500000000)
Startpoint (53.172032808, -1.631089766, 10.500000000) Endpoint (60.005366141, -1.631089766, 10.500000000)
Startpoint (60.005366141, -1.631089766, 0.000000000) Endpoint (60.005366141, -1.631089766, 10.500000000)
Startpoint (53.172032808, -1.631089766, 10.500000000) Endpoint (53.172032808, -16.631089766, 10.500000000)""")
c_script = CSharpScript(vals=panel_15)  # -> out, A, B, C; inputs vals: list of String; disabled
# ---------- c_script: C# ----------
    List<Line> lns = new List<Line>();
    List<double> nums = new List<double>();
    List<string> dat = new List<string>();
    int count = 0;
    DataTree<double> nums2 = new DataTree<double>();

    GH_Path pa = new GH_Path(0);
    
    for(int i = 0; i < vals.Count; i++){
      string[] val = vals[i].Split(' ');

     
      for(int j = 0; j < val.Length; j++){
        string v = val[j].Replace('(', ' ');
        v = v.Replace(')', ' ');
        v = v.Replace(',', ' ');
        dat.Add(v);
        double num;

        if(double.TryParse(v, out num)){
          nums.Add(num);
          if(count % 6 == 0)
            pa = new GH_Path(count / 6);
          
          nums2.Add(num, pa);
          count++;
        }

      }
    }


    A = dat;
    B = nums;
    C = nums2;
# ---------- end c_script ----------
panel_16 = Panel(c_script.C)
numbers_to_points = NumbersToPoints(Numbers=c_script.C, Mask=4)
polyline = PolyLine(Vertices=numbers_to_points, Closed=False)

numbers_to_points_2 = NumbersToPoints(Numbers=max_pt, Mask=4)
numbers_to_points_3 = NumbersToPoints(Numbers=min_pt, Mask=4)
construct_point = ConstructPoint(XCoordinate=0, YCoordinate=0, ZCoordinate=levels)
list_item = ListItem(List=levels, Index=0, Wrap=True)  # -> Item, Item1
rectangle = Rectangle(Plane=PlaneXY(0, 0, 0), XSize="10", YSize="15", Radius=0)  # -> Rectangle, Length
numbers_to_points_4 = NumbersToPoints(Numbers=max_pt_2, Mask=4)
numbers_to_points_5 = NumbersToPoints(Numbers=min_pt_2, Mask=4)
numbers_to_points_6 = NumbersToPoints(Numbers=panel, Mask=4)
numbers_to_points_7 = NumbersToPoints(Numbers=panel_2, Mask=4)
numbers_to_points_8 = NumbersToPoints(Numbers=panel_3, Mask=4)
numbers_to_points_9 = NumbersToPoints(Numbers=panel_4, Mask=4)
numbers_to_points_10 = NumbersToPoints(Numbers=panel_5, Mask=4)
numbers_to_points_11 = NumbersToPoints(Numbers=panel_6, Mask=4)
numbers_to_points_12 = NumbersToPoints(Numbers=panel_7, Mask=4)
numbers_to_points_13 = NumbersToPoints(Numbers=panel_8, Mask=4)
numbers_to_points_14 = NumbersToPoints(Numbers=panel_9, Mask=4)
numbers_to_points_15 = NumbersToPoints(Numbers=panel_10, Mask=4)
numbers_to_points_16 = NumbersToPoints(Numbers=panel_11, Mask=4)
numbers_to_points_17 = NumbersToPoints(Numbers=panel_12, Mask=4)
box_2pt = Box2Pt(PointA=numbers_to_points_2, PointB=numbers_to_points_3, Plane=PlaneXY(0, 0, 0))
rectangle_2pt = Rectangle2Pt(Plane=PlaneXY(0, 0, 0), PointA=numbers_to_points_2, PointB=numbers_to_points_3, Radius=0)  # -> Rectangle, Length
explode = Explode(Curve=rectangle.Rectangle, Recursive=True)  # -> Segments, Vertices
xy_plane = XYPlane(Origin=construct_point)
box_2pt_2 = Box2Pt(PointA=numbers_to_points_4, PointB=numbers_to_points_5, Plane=PlaneXY(0, 0, 0))
area = Area(Geometry=rectangle_2pt.Rectangle)  # -> Area, Centroid
panel_17 = Panel("""-0.161300526
-1.631089766
5.000000000""")
panel_18 = Panel("""-9.494633859
-1.631089766
5.000000000""")
panel_19 = Panel("""-9.494633859
-1.631089766
5.000000000""")
panel_20 = Panel("""-9.494633859
-15.964423099
5.000000000""")
panel_21 = Panel("""-0.161300526
-15.964423099
5.000000000""")
panel_22 = Panel("""-9.494633859
-15.964423099
5.000000000""")
panel_23 = Panel("""-0.161300526
-15.964423099
5.000000000""")
panel_24 = Panel("""-0.161300526
-1.631089766
5.000000000""")
wall = Wall(Curve=explode.Segments, Height=list_item.Item1, Width=Slider(0.75, range=0..1))  # -> flatten(Element), flatten(Geometry)
deconstruct_box = DeconstructBox(Box=box_2pt_2)  # -> Plane, X, Y, Z
box_corners = BoxCorners(Box=box_2pt_2)  # -> CornerA, CornerB, CornerC, CornerD, CornerE, CornerF, CornerG, CornerH
panel_25 = Panel(area.Area)
numbers_to_points_18 = NumbersToPoints(Numbers=panel_17, Mask=4)
numbers_to_points_19 = NumbersToPoints(Numbers=panel_18, Mask=4)
numbers_to_points_20 = NumbersToPoints(Numbers=panel_19, Mask=4)
numbers_to_points_21 = NumbersToPoints(Numbers=panel_20, Mask=4)
numbers_to_points_22 = NumbersToPoints(Numbers=panel_22, Mask=4)
numbers_to_points_23 = NumbersToPoints(Numbers=panel_21, Mask=4)
numbers_to_points_24 = NumbersToPoints(Numbers=panel_23, Mask=4)
numbers_to_points_25 = NumbersToPoints(Numbers=panel_24, Mask=4)
panel_26 = Panel(wall.Geometry)
panel_27 = Panel(deconstruct_box.X)
panel_28 = Panel(deconstruct_box.Y)
panel_29 = Panel(deconstruct_box.Z)
xz_plane = XZPlane(Origin=box_corners.CornerF)
panel_30 = Panel("""10.5053661410913,-21.7977564327571,0
25.5053661410913,-21.7977564327571,0
10.5053661410913,-21.7977564327571,0
10.5053661410912,-33.7977564327571,0
25.5053661410913,-33.7977564327571,0
25.5053661410913,-21.7977564327571,8""")
panel_31 = Panel("""10.5053661410913,-1.63108976609043,10
10.5053661410913,-1.63108976609043,0
10.5053661410913,-16.6310897660904,10
25.5053661410913,-16.6310897660905,10
25.5053661410913,-1.63108976609048,10
10.5053661410913,-1.63108976609043,10""")
aligned_dimension = AlignedDimension(Plane=xz_plane, PointA=box_corners.CornerB, PointB=box_corners.CornerF, Offset=1, Text="{0:0.00}", Size=1)
distance = Distance(PointA=box_corners.CornerA, PointB=box_corners.CornerB)
distance_2 = Distance(PointA=box_corners.CornerB, PointB=box_corners.CornerC)
distance_3 = Distance(PointA=box_corners.CornerB, PointB=box_corners.CornerF)
panel_32 = Panel("""150.187885115627,-19.1802723573068,15
120.187885115627,-19.1802723573067,15
120.187885115627,-19.8469390239734,15
110.937007615209,-19.8469390239734,15
115.420363026803,-49.1802723573066,15
159.43876301349,-19.8469390239734,5
159.43876301349,-19.8469390239734,5
154.955437986307,-49.1802723573067,5
115.420363026803,-49.1802723573066,5
110.937007615209,-19.8469390239734,5
120.187885115627,-19.8469390239734,5
120.187885115627,-19.1802723573067,5
150.187885115627,-19.1802723573068,5
150.187885115627,-19.8469390239734,15
150.187885115627,-19.8469390239734,15
159.43876301349,-19.8469390239734,15
159.43876301349,-19.8469390239734,5
150.187885115627,-19.1802723573068,15
150.187885115627,-19.1802723573068,15
150.187885115627,-19.8469390239734,15
150.187885115627,-19.8469390239734,5""")
aligned_dimension_2 = AlignedDimension(Plane=PlaneXY(0, 0, 0), PointA=box_corners.CornerB, PointB=box_corners.CornerC, Offset=1, Text="{0:0.00}", Size=1)

# ----
# Include geometry objects not visible
# ViewDetail - Fine - geo element
# geo element - solid
# solid - edge array
# List of 12 edges - edge
# edge - ascurve
# as curve - line
# line - tesselate
# tesselate - xyz, xyz
panel_33 = Panel("""-0.161300526
-1.631089766
10.000000000""")
panel_34 = Panel("""-9.494633859
-1.631089766
10.000000000""")
panel_35 = Panel("""-9.494633859
-1.631089766
10.000000000""")
panel_36 = Panel("""-9.494633859
-15.964423099
10.000000000""")
panel_37 = Panel("""-9.494633859
-15.964423099
10.000000000""")
panel_38 = Panel("""-0.161300526
-15.964423099
10.000000000""")
panel_39 = Panel("""-0.161300526
-15.964423099
10.000000000""")
panel_40 = Panel("""-0.161300526
-1.631089766
10.000000000""")
panel_41 = Panel("""-0.161300526
-1.631089766
0.000000000""")
panel_42 = Panel("""-0.161300526
-15.964423099
0.000000000""")
panel_43 = Panel("""-0.161300526
-15.964423099
0.000000000""")
panel_44 = Panel("""-9.494633859
-15.964423099
0.000000000""")
panel_45 = Panel("""-9.494633859
-15.964423099
0.000000000""")
panel_46 = Panel("""-9.494633859
-1.631089766
0.000000000""")
panel_47 = Panel("""-9.494633859
-1.631089766
0.000000000""")
panel_48 = Panel("""-0.161300526
-1.631089766
0.000000000""")
panel_49 = Panel("""-0.161300526
-1.631089766
10.000000000""")
panel_50 = Panel("""-0.161300526
-1.631089766
0.000000000""")
panel_51 = Panel("""-9.494633859
-1.631089766
0.000000000""")
panel_52 = Panel("""-9.494633859
-1.631089766
10.000000000""")
panel_53 = Panel("""-9.494633859
-15.964423099
0.000000000""")
panel_54 = Panel("""-9.494633859
-15.964423099
10.000000000""")
panel_55 = Panel("""-0.161300526
-15.964423099
0.000000000""")
panel_56 = Panel("""-0.161300526
-15.964423099
10.000000000""")
numbers_to_points_26 = NumbersToPoints(Numbers=panel_33, Mask=4)
numbers_to_points_27 = NumbersToPoints(Numbers=panel_34, Mask=4)
numbers_to_points_28 = NumbersToPoints(Numbers=panel_35, Mask=4)
numbers_to_points_29 = NumbersToPoints(Numbers=panel_36, Mask=4)
numbers_to_points_30 = NumbersToPoints(Numbers=panel_37, Mask=4)
numbers_to_points_31 = NumbersToPoints(Numbers=panel_38, Mask=4)
numbers_to_points_32 = NumbersToPoints(Numbers=panel_39, Mask=4)
numbers_to_points_33 = NumbersToPoints(Numbers=panel_40, Mask=4)
numbers_to_points_34 = NumbersToPoints(Numbers=panel_41, Mask=4)
numbers_to_points_35 = NumbersToPoints(Numbers=panel_42, Mask=4)
numbers_to_points_36 = NumbersToPoints(Numbers=panel_43, Mask=4)
numbers_to_points_37 = NumbersToPoints(Numbers=panel_44, Mask=4)
numbers_to_points_38 = NumbersToPoints(Numbers=panel_45, Mask=4)
numbers_to_points_39 = NumbersToPoints(Numbers=panel_46, Mask=4)
numbers_to_points_40 = NumbersToPoints(Numbers=panel_47, Mask=4)
numbers_to_points_41 = NumbersToPoints(Numbers=panel_48, Mask=4)
numbers_to_points_42 = NumbersToPoints(Numbers=panel_49, Mask=4)
numbers_to_points_43 = NumbersToPoints(Numbers=panel_50, Mask=4)
numbers_to_points_44 = NumbersToPoints(Numbers=panel_51, Mask=4)
numbers_to_points_45 = NumbersToPoints(Numbers=panel_52, Mask=4)
numbers_to_points_46 = NumbersToPoints(Numbers=panel_53, Mask=4)
numbers_to_points_47 = NumbersToPoints(Numbers=panel_54, Mask=4)
numbers_to_points_48 = NumbersToPoints(Numbers=panel_55, Mask=4)
numbers_to_points_49 = NumbersToPoints(Numbers=panel_56, Mask=4)
line = Line(StartPoint=numbers_to_points_26, EndPoint=numbers_to_points_27)
line_2 = Line(StartPoint=numbers_to_points_28, EndPoint=numbers_to_points_29)
line_3 = Line(StartPoint=numbers_to_points_30, EndPoint=numbers_to_points_31)
line_4 = Line(StartPoint=numbers_to_points_32, EndPoint=numbers_to_points_33)
line_5 = Line(StartPoint=numbers_to_points_34, EndPoint=numbers_to_points_35)
line_6 = Line(StartPoint=numbers_to_points_36, EndPoint=numbers_to_points_37)
line_7 = Line(StartPoint=numbers_to_points_38, EndPoint=numbers_to_points_39)
line_8 = Line(StartPoint=numbers_to_points_40, EndPoint=numbers_to_points_41)
line_9 = Line(StartPoint=numbers_to_points_42, EndPoint=numbers_to_points_43)
line_10 = Line(StartPoint=numbers_to_points_44, EndPoint=numbers_to_points_45)
line_11 = Line(StartPoint=numbers_to_points_46, EndPoint=numbers_to_points_47)
line_12 = Line(StartPoint=numbers_to_points_48, EndPoint=numbers_to_points_49)
merge = Merge(
    Data1=line,
    Data2=line_2,
    Data3=line_3,
    Data4=line_4,
    Data5=line_5,
    Data6=line_6,
    Data7=line_7,
    Data8=line_8,
    Data9=line_9,
    Data10=line_10,
    Data11=line_11,
    Data12=line_12)
join_curves = JoinCurves(Curves=merge, Preserve=False)
panel_57 = Panel(join_curves)

panel_58 = Panel(distance)
panel_59 = Panel(distance_2)
panel_60 = Panel(distance_3)
aligned_dimension_3 = AlignedDimension(Plane=PlaneXY(0, 0, 0), PointA=box_corners.CornerA, PointB=box_corners.CornerB, Offset=1, Text="{0:0.00}", Size=1)
panel_61 = Panel("""159.493580789151,-9.84047274716989,10
157.030535019863,20.3574188167638,10
149.518976457776,49.7096885303146,10
159.493580789151,-9.84047274716989,10
157.030535019863,20.3574188167638,10
149.518976457776,49.7096885303146,10
149.518976457775,49.7096885303157,10
120.85679377348,49.709688530318,10
113.345235211393,20.3574188167717,10
110.882189442104,-9.84047274715754,10
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""")
panel_62 = Panel("Unbound Height = 10")

location_point = Panel("""-5.08448454273062
-8.38817915252346
0""")
numbers_to_points_50 = NumbersToPoints(Numbers=location_point, Mask=4)

multiplication = Multiplication(A=panel_58, B=panel_59)
surface_area = Panel(multiplication)

multiplication_2 = Multiplication(A=panel_58, B="2")
multiplication_3 = Multiplication(A="2", B=panel_59)
addition = Addition(A=multiplication_2, B=multiplication_3)
perimiter = Panel(addition)

point = Point(panel_32)  # disabled
list_item_2 = ListItem(List=flatten(polyline), Index=Slider(15, range=0..36), Wrap=True)
polyline_2 = PolyLine(Vertices=point, Closed=False)  # disabled
c_script_2 = CSharpScript(Reference="C:\Users\cportelli\Documents\Personal\GitHub\Coding_Sketchbook\Revit\Rooms_Extract_Data\Rooms_Extract_Data\bin\Debug\Newtonsoft.Json.dll")  # -> out, A, B, C
# ---------- c_script_2: C# usings ----------
using Newtonsoft.Json;
# ---------- c_script_2: C# ----------
    string vals = System.IO.File.ReadAllText(@"C:\Users\cportelli\Documents\Personal\GitHub\Coding_Sketchbook\Revit\Rooms_Extract_Data\Rooms_Extract_Data\bin\Debug\myRooms.rooms");

    var rm = Newtonsoft.Json.JsonConvert.DeserializeObject(vals);
    List<mRoom> rooms = Newtonsoft.Json.JsonConvert.DeserializeObject<List<mRoom>>(vals);


    DataTree<Curve> crvs = new DataTree<Curve>();

    for(int i = 0; i < rooms.Count; i++){


      for(int j = 0; j < rooms[i].Faces.Count; j++){

        GH_Path pa = new GH_Path(new int[] { i, j});

        for(int k = 0; k < rooms[i].Faces[j].Lines.Count; k++){

          Point3d stpt = new Point3d(rooms[i].Faces[j].Lines[k].StartPoint.X,
            rooms[i].Faces[j].Lines[k].StartPoint.Y,
            rooms[i].Faces[j].Lines[k].StartPoint.Z);


          Point3d endpt = new Point3d(rooms[i].Faces[j].Lines[k].EndPoint.X,
            rooms[i].Faces[j].Lines[k].EndPoint.Y,
            rooms[i].Faces[j].Lines[k].EndPoint.Z);


          Line ln = new Line(stpt, endpt);
          crvs.Add(ln.ToNurbsCurve(), pa);
        }

        for(int k = 0; k < rooms[i].Faces[j].Curves.Count; k++){

          Point3d stpt = new Point3d(rooms[i].Faces[j].Curves[k].StartPoint.X,
            rooms[i].Faces[j].Curves[k].StartPoint.Y,
            rooms[i].Faces[j].Curves[k].StartPoint.Z);

          Point3d midpt = new Point3d(rooms[i].Faces[j].Curves[k].MidPoint.X,
            rooms[i].Faces[j].Curves[k].MidPoint.Y,
            rooms[i].Faces[j].Curves[k].MidPoint.Z);

          Point3d endpt = new Point3d(rooms[i].Faces[j].Curves[k].EndPoint.X,
            rooms[i].Faces[j].Curves[k].EndPoint.Y,
            rooms[i].Faces[j].Curves[k].EndPoint.Z);


          Arc arc = new Arc(stpt, midpt, endpt);
          crvs.Add(arc.ToNurbsCurve(), pa);
        }
      }
    }




    A = rm;
    B = rooms;
    C = crvs;
# ---------- c_script_2: C# additional code ----------
  public class mPoint
  {
    public double X;
    public double Y;
    public double Z;

    public mPoint (double x, double y, double z)
    {
      this.X = x;
      this.Y = y;
      this.Z = z;
    }



    public override string ToString()
    {
      return string.Format("{0},{1},{2}", this.X, this.Y, this.Z);
    }
  }

  public class mLine
  {
    public mPoint StartPoint { get; set; }
    public mPoint EndPoint { get; set; }

    public mLine() { }

    public mLine(mPoint Stpt, mPoint EndPt)
    {
      this.StartPoint = Stpt;
      this.EndPoint = EndPt;
    }
  }

  public class mCurve
  {
    public mPoint StartPoint { get; set; }
    public mPoint MidPoint { get; set; }
    public mPoint EndPoint { get; set; }

    public mCurve() { }

    public mCurve(mPoint StPt, mPoint MidPt, mPoint EndPt)
    {
      this.StartPoint = StPt;
      this.MidPoint = MidPt;
      this.EndPoint = EndPt;
    }
  }

  public class mFace
  {
    public List<mLine> Lines { get; set; }
    public List<mCurve> Curves { get; set; }

    public mFace() {
      Lines = new List<mLine>();
      Curves = new List<mCurve>();
    }
  }

  public class mRoom
  {

    public string LevelName { get; set; }

    public string LevelID { get; set; }

    public string UpperLevelName { get; set; }

    public double Height { get; set; }

    public string Name { get; set; }
    public string Number { get; set; }


    public double Perimiter { get; set; }

    public double Area { get; set; }

    public double Volume { get; set; }

    public List<mFace> Faces { get; set; }

    public mPoint MaxPt { get; set; }
    public mPoint MinPt { get; set; }


    public mRoom()
    {
      Faces = new List<mFace>();
    }

  }
# ---------- end c_script_2 ----------
numbers_to_points_51 = NumbersToPoints(Numbers=panel_61, Mask=4)
point_2 = Point(panel_61)  # disabled
c_script_3 = CSharpScript(vals=panel_61)  # -> out, A, B, C; inputs vals: list of String; same code as c_script
polyline_3 = PolyLine(Vertices=point_2, Closed=False)  # disabled
panel_63 = Panel(c_script_3.A)

c_script_4 = CSharpScript(
    x=Toggle(False),
    Reference=["C:\Users\cportelli\Documents\Personal\GitHub\Coding_Sketchbook\Revit\Rooms_Extract_Data\Rooms_Extract_Data\bin\Debug\Newtonsoft.Json.dll", "C:\Users\cportelli\Documents\Personal\GitHub\Coding_Sketchbook\Revit\Rooms_Extract_Data\Types\bin\Debug\Types.dll"])  # -> out, A, B, C, D; inputs x: Boolean
# ---------- c_script_4: C# usings ----------
using mTypes;
# ---------- c_script_4: C# ----------
    if(x){
      string vals = System.IO.File.ReadAllText(@"C:\Users\cportelli\Documents\Personal\GitHub\Coding_Sketchbook\Revit\Rooms_Extract_Data\Rooms_Extract_Data\bin\Debug\myRooms.rooms");

      var rm = Newtonsoft.Json.JsonConvert.DeserializeObject(vals);
      List<mRoom> rooms = Newtonsoft.Json.JsonConvert.DeserializeObject<List<mRoom>>(vals);


      DataTree<Curve> crvs = new DataTree<Curve>();

      for(int i = 0; i < rooms.Count; i++){


        for(int j = 0; j < rooms[i].Faces.Count; j++){

          GH_Path pa = new GH_Path(new int[] { i, j});

          for(int k = 0; k < rooms[i].Faces[j].Lines.Count; k++){

            Point3d stpt = new Point3d(rooms[i].Faces[j].Lines[k].StartPoint.x,
              rooms[i].Faces[j].Lines[k].StartPoint.y,
              rooms[i].Faces[j].Lines[k].StartPoint.z);


            Point3d endpt = new Point3d(rooms[i].Faces[j].Lines[k].EndPoint.x,
              rooms[i].Faces[j].Lines[k].EndPoint.y,
              rooms[i].Faces[j].Lines[k].EndPoint.z);


            Line ln = new Line(stpt, endpt);
            crvs.Add(ln.ToNurbsCurve(), pa);
          }

          for(int k = 0; k < rooms[i].Faces[j].Curves.Count; k++){

            Point3d stpt = new Point3d(rooms[i].Faces[j].Curves[k].StartPoint.x,
              rooms[i].Faces[j].Curves[k].StartPoint.y,
              rooms[i].Faces[j].Curves[k].StartPoint.z);

            Point3d midpt = new Point3d(rooms[i].Faces[j].Curves[k].MidPoint.x,
              rooms[i].Faces[j].Curves[k].MidPoint.y,
              rooms[i].Faces[j].Curves[k].MidPoint.z);

            Point3d endpt = new Point3d(rooms[i].Faces[j].Curves[k].EndPoint.x,
              rooms[i].Faces[j].Curves[k].EndPoint.y,
              rooms[i].Faces[j].Curves[k].EndPoint.z);


            Arc arc = new Arc(stpt, midpt, endpt);
            crvs.Add(arc.ToNurbsCurve(), pa);
          }


          for(int k = 0; k < rooms[i].Faces[j].Splines.Count; k++){

            List<Point3d> pts = new List<Point3d>();

            for (int m = 0; m < rooms[i].Faces[j].Splines[k].Points.Count; m++){
              Point3d stpt = new Point3d(rooms[i].Faces[j].Splines[k].Points[m].x,
                rooms[i].Faces[j].Splines[k].Points[m].y,
                rooms[i].Faces[j].Splines[k].Points[m].z);
              pts.Add(stpt);
            }

            Curve crv = Curve.CreateInterpolatedCurve(pts, 3);

            crvs.Add(crv, pa);
          }
        }
      }


      A = rm;
      B = rooms;
      C = crvs;
      D = rooms;
    }
# ---------- end c_script_4 ----------
join_curves_2 = JoinCurves(Curves=c_script_4.C, Preserve=False)  # -> simplify(Curves)
panel_64 = Panel(c_script_4.out)
patch = Patch(Curves=join_curves_2, Spans=20, Flexibility=1, Trim=True)
shift_paths = ShiftPaths(Data=join_curves_2, Offset=-1)
shift_paths_2 = ShiftPaths(Data=patch, Offset=-1)
panel_65 = Panel(shift_paths)
brep_join = BrepJoin(Breps=shift_paths_2)  # -> Breps, Closed
param_viewer = ParamViewer(shift_paths_2)

c_script_5 = CSharpScript(
    Room=c_script_4.D,
    Reference=["C:\Users\cportelli\Documents\Personal\GitHub\Coding_Sketchbook\Revit\Rooms_Extract_Data\Rooms_Extract_Data\bin\Debug\Newtonsoft.Json.dll", "C:\Users\cportelli\Documents\Personal\GitHub\Coding_Sketchbook\Revit\Rooms_Extract_Data\Types\bin\Debug\Types.dll"])  # -> out, Perimiter, Area, Volume, Name, Number, Level, Upper_Level; inputs Room: list
# ---------- c_script_5: C# ----------
    List<double> perimiter = new List<double>();
    List<double> area = new List<double>();
    List<double> volume = new List<double>();
    List<string> name = new List<string>();
    List<string> number = new List<string>();
    List<string> level = new List<string>();
    List<string> upperlevel = new List<string>();

  
    if (Room.Count > 0 && Room[0] != null){
      for(int i = 0; i < Room.Count; i++){
        mRoom rm = Room[i] as mRoom;

        perimiter.Add(rm.Perimiter == double.NaN ? double.NaN : rm.Perimiter);
        area.Add(rm.Area == double.NaN ? double.NaN : rm.Area);
        volume.Add(rm.Volume == double.NaN ? double.NaN : rm.Volume);
        name.Add(rm.Name == null ? null : rm.Name);
        number.Add(rm.Number == null ? null : rm.Number);
        level.Add(rm.LevelName == null ? null : rm.LevelName);
        upperlevel.Add(rm.UpperLevelName == null ? null : rm.UpperLevelName);

      }

      Print(Room.Count.ToString());
      Perimiter = perimiter;
      Area = area;
      Volume = volume;
      Name = name;
      Number = number;
      Level = level;
      Upper_Level = upperlevel;
    }
# ---------- end c_script_5 ----------
panel_66 = Panel(c_script_5.out)
